# Dynamo graph 1_SEGMENTACION_MUROS.dyn (Dynamo 2.17.0.3472)
# packages: archi-lab.net 2023.213.1722, Clockwork for Dynamo 2.x 2.4.0

# group: SELECCION DE ELEMENTOS TIPO MURO
python_script = Python()  # CPython3; graph output; unwired: IN[0]
# ---------- python_script.python (36 lines) ----------
# Importar los módulos necesarios
import clr
import sys

clr.AddReference("RevitServices")
import RevitServices
from RevitServices.Persistence import DocumentManager
from RevitServices.Transactions import TransactionManager

clr.AddReference("RevitNodes")
import Revit
clr.ImportExtensions(Revit.Elements)
clr.ImportExtensions(Revit.GeometryConversion)

clr.AddReference('RevitAPI')
clr.AddReference('RevitAPIUI')
from Autodesk.Revit.DB import FilteredElementCollector, BuiltInCategory, WallUtils 

# Obtener el documento activo de Revit
doc = DocumentManager.Instance.CurrentDBDocument
uidoc = DocumentManager.Instance.CurrentUIDocument

element_collector =  FilteredElementCollector(doc, doc.ActiveView.Id).OfCategory(BuiltInCategory.OST_Walls).WhereElementIsNotElementType().ToElements()

TransactionManager.Instance.EnsureInTransaction(doc);

for i in range(len(element_collector)):
    try:
        WallUtils.DisallowWallJoinAtEnd(element_collector[i],0)
        WallUtils.DisallowWallJoinAtEnd(element_collector[i],1)
    except :
        print('error')
 #Maybe Throw an Error Message...
TransactionManager.Instance.TransactionTaskDone()

OUT=element_collector
# ----------------------------------------

# group: Eliminar muros originales
eliminar_el_listado_de_muros = Python(IN[0]=python_script)  # CPython3; frozen
# ---------- eliminar_el_listado_de_muros.python (24 lines) ----------
# Load the Python Standard and DesignScript Libraries
import clr
clr.AddReference("RevitServices")
import RevitServices
from RevitServices.Persistence import DocumentManager
from RevitServices.Transactions import TransactionManager

# The inputs to this node will be stored as a list in the IN variables.
doc = DocumentManager.Instance.CurrentDBDocument

# Place your code below this line
Elementos = UnwrapElement(IN[0])
Lista = []

for i in Elementos:
    try:
        TransactionManager.Instance.EnsureInTransaction(doc)
        doc.Delete(i.Id)
        TransactionManager.Instance.TransactionTaskDone()
        Lista.append("Borrado")
    except:
        Lista.append("No Borrado")
          
OUT = Lista
# ----------------------------------------
code_block = CodeBlock { 180; }
pause = Thread.Pause(object=eliminar_el_listado_de_muros, msTimeout=code_block)

# group: PARAMETRO DE IMPRESORA PARA DIVISIÓN
longitud_de_corte_m = DoubleSlider(2.5, range=0.5..5 step 1)  # graph input
borde_m = DoubleSlider(0.7, range=0..1 step 0.05)  # graph input

# group: LISTA DE ELEMENTOS CLASIFICADOS SEGUN EL CASO DE DIVISIÓN
name = ElementType.Name(elementType=python_script)
groupByKey = List.GroupByKey(list=python_script, keys=name)
byKeysValues = DesignScript.Builtin.Dictionary.ByKeysValues(keys=groupByKey.uniqueKeys, values=groupByKey.groups)
python_script_2 = Python(IN[0]=byKeysValues, IN[1]=longitud_de_corte_m)  # CPython3
# ---------- python_script_2.python (139 lines) ----------
#Load the Python Standard and DesignScript Libraries
import sys
import clr
clr.AddReference('ProtoGeometry')
from Autodesk.DesignScript.Geometry import *

# Import RevitNodes
clr.AddReference("RevitNodes")
import Revit

# Import Revit elements
from Revit.Elements import *

# The inputs to this node will be stored as a list in the IN variables.
dataEnteringNode = IN

# Se recibe un objecto con un lista por cada tipo de muro existente
allWalls = IN[0]

# Funcion para ordenar una lista de objetos por el valor distanceFromOrigin
def sortListOfDictsByDistanceFromOrigin(listDicts):
    return sorted(listDicts, key=lambda k: k['distanceFromOrigin'])


# Se define una función para crear un objecto que contenga todos los muros con info ùtil para segmentarlos
def wallsObjectGenerator():
    dictWalls = {}
    planes = []
    # Se recorre por key val el objecto con listas de muros
    
    for keyWall, valueWall in allWalls.items():
        myObjects = []
        myPlanes = []
        # Posteriormente recorremos cada muro dentro de las listas
        for subel in valueWall:
            
            # Obtenemos la coordenada de origen del muro
            originWall = subel.GetLocation().StartPoint
            try:
                normalizeDirection = subel.GetLocation().Direction.Normalized()
                normalToDirection = subel.GetLocation().NormalAtParameter()
            except:
                pass
            
            #Obtenemos todos los posibles elementos que albergue el muro
            hostedElements = subel.GetHostedElements(True, True, True)
            hostedAndLocation = []
            
            # Recorremos los elementos que están incrustados en el muro
            for el in hostedElements:
                # Puesto que las ventanas y puertas en revit están nombradas por sus dimensiones, obtenemos el ancho del elemento basado en su nombre, lo convertimos a un double y guardamos esa varible
                hostType = el.ElementType
                hostTypeProperties = hostType.Parameters
                hostWidth = hostType.GetParameterValueByName("Width")
                hostHeight = hostType.GetParameterValueByName("Height")
                
                # Para cada elemento alojado en el muro obtenemos: la distancia desde el origen, categorìa del elemento, id, el elemento como tal, la coordenada al centro del elemento. Posteriormente guardamos estos parátros en un objeto que se guardará en la lista hostedAndLocation
                
                # Se obtiene las coordenadas del hosted element y se trasladata en Z = 0, restando su mismo valor con el método translate
                hostLoc = el.GetLocation()
                hostLoc = hostLoc.Translate(0, 0, -hostLoc.Z)
                
                hostedAndLocation.append({
                    "distanceFromOrigin": originWall.DistanceTo(el.GetLocation()),
                    "Category": el.GetCategory,
                    "elementId": el.Id,
                    "hostedName": el,
                    "location": hostLoc,
                    "hostWidth": hostWidth,
                    "hostHeight": hostHeight
                })
            
            # Se ordenan los objectos dentro de la lista antes de calcular las distancias desde el origen y guardarlos 
            hostedAndLocation = sortListOfDictsByDistanceFromOrigin(hostedAndLocation)
           
            # Se crean dos listas, en la primera se guardará la distancia entre un elemento y otro, en la segunda, pasaremos por un condicional de distancia, si la distancia entre los bordes de los elementos es menor a X longitud, deberá generarse un plano de corte entre los elementos
            distances = []
            messages = []
            cutPlanes = []
            for i in range(len(hostedAndLocation)-1):
            
                # Se recorren los hosted elements, y se calcula la distancia entre el elemento i y el elemento i+1 de la lista
                p1 = hostedAndLocation[i]["location"]
                p2 = hostedAndLocation[i+1]["location"]
                d = p1.DistanceTo(p2)
                distances.append(d)
                # elsWidht contiene la suma de los anchos de los dos i e i+1
                elsWidth = (hostedAndLocation[i]["hostWidth"] + hostedAndLocation[i+1]["hostWidth"])
                halfWidth = hostedAndLocation[i]["hostWidth"]/2
                # Al restar d - elsWidth/2 obtenemos la distancia entre bordes internos de los elementos y al sumar elsWidth obtenemos la distancia a bordes externos
                dToElementBorders = d - (elsWidth/2) + elsWidth
                cutDistanceFromP1 = halfWidth + dToElementBorders/2
                distanceVector = normalizeDirection.Scale(cutDistanceFromP1)
                
                # Luego hacemos unos comparativos, en el primero decimos que si la distancia a bordes externos es menor a 2.20 m, entonces que nos escriba un mensaje  diciendo que debe ir un plano de corte en medio de los dos elementos, en caso contrario que nos diga cuál es la longitud a bordes externos
                if (dToElementBorders < 5):
                    message = "Entre " + str(hostedAndLocation[i]["hostedName"]) + " y " + str(hostedAndLocation[i+1]["hostedName"]) + "Debe ir un plano de corte"
                    cuttingPoint = p1.Add(distanceVector)
                    cuttingPlane = Plane.ByOriginNormal(p1, normalToDirection)
                    cutPlanes.append(cuttingPlane)
                    messages.append(message)
                elif (dToElementBorders > 6):
                    message = "Entre " + str(hostedAndLocation[i]["hostedName"]) + " y " + str(hostedAndLocation[i+1]["hostedName"]) +   " Hay una longitud de " + str(dToElementBorders) + " entre bordes externos"
                    messages.append(message)
            
            # Creamos un objeto llamado myObject, en donde guardarmos la información del muro, las distancias entre elementos, los mensajes de advertencia y los elementos embebidos en el muro.            
            myObject = {
                "element": {
                    "name": subel,
                    "id": subel.Id,
                    "lengthWall": subel.GetParameterValueByName("Length"),
                    
                    "wallLocation": {
                        "startPoint": subel.GetLocation().StartPoint,
                        "endPoint": subel.GetLocation().EndPoint,
                        "wallLocation": subel.GetLocation(),
                        #"direction": subel.GetLocation().Direction if subel.GetLocation() else 0,
                        #"normalVector": subel.GetLocation().Direction.Normalized() if subel.GetLocation() else 0,
                    },
                    "distances": distances,
                    "Messages": messages
                },
                "hostedElements": hostedAndLocation,
                "Plano de corte": cutPlanes
            }
            # Guardamos el objeto con la información del muro en una lista con los otros muros
            myObjects.append(myObject)
            myPlanes.append(cutPlanes)
        
        # Luego volvemos a guardar el listado de muros por tipo
        dictWalls[keyWall] = myObjects
        planes = myPlanes
    # como resultado, retornamos un diccionario/objeto con los tipos de muros con la información requerida para el proceso posterior.
    return dictWalls, planes
# Assign your output to the OUT variable.



OUT = wallsObjectGenerator()
# ----------------------------------------
clasificacion_de_muros = Python(IN[0]=python_script_2, IN[1]=longitud_de_corte_m)  # CPython3
# ---------- clasificacion_de_muros.python (56 lines) ----------
# Load the Python Standard and DesignScript Libraries
import sys
import clr
clr.AddReference('ProtoGeometry')
from Autodesk.DesignScript.Geometry import *

# Import RevitNodes
clr.AddReference("RevitNodes")
#clr.AddReference("WombatDynamo")

import Revit
#import WombatDynamo

# Import Revit elements
from Revit.Elements import *

# The inputs to this node will be stored as a list in the IN variables.
dataEnteringNode = IN
dic_muros_host = IN[0]
corte = IN[1]
dic_muros_host = dic_muros_host[0]

# Place your code below this line
# Funcion para ordenar una lista de objetos por el valor distanceFromOrigin
def sortListOfDictsByDistanceFromOrigin(listDicts):
    return sorted(listDicts, key=lambda k: k['distanceFromOrigin'])

def typeWalls(distanceWall,lenHostedElements):
    if (distanceWall < corte and lenHostedElements == 0 ):
        return "Muro Limpio menor"
    if (distanceWall < corte and lenHostedElements >= 0):
        return "Muro hueco menor"
    if (distanceWall > corte and lenHostedElements == 0):
        return "Muro Limpio mayor"
    if (distanceWall > corte and lenHostedElements >= 0):
        return "Muro hueco mayor"
    

def pointsBySegment(dic_muros_host):
    dictSegments = []
    for val in dic_muros_host.values():
        # dictSegments.append(key)
        dictSegments.append(len(val))
        for muro in val: 
            distanceWall = muro['element']["lengthWall"]
            lenHostedElements=len(muro['hostedElements'])
            y=typeWalls(distanceWall,lenHostedElements)
            #dictSegments.append(lenHostedElements)
            dictSegments.append(muro["element"]['id'])
            dictSegments.append(y)
            
            
    return dictSegments

# Assign your output to the OUT variable.
OUT = pointsBySegment(dic_muros_host)
# ----------------------------------------
lista_muros_limpios_mayores = Python(IN[0]=clasificacion_de_muros)  # CPython3
# ---------- lista_muros_limpios_mayores.python (31 lines) ----------
# Load the Python Standard and DesignScript Libraries
import sys
import clr
clr.AddReference('ProtoGeometry')
from Autodesk.DesignScript.Geometry import *

# The inputs to this node will be stored as a list in the IN variables.
dataEnteringNode = IN

# Place your code below this line
all=IN[0]

wallsClean = []
listWall = []
boleanElements = []

for i in range(2, len(all), 2):
    listWall.append(all[i - 1])
    if (all[i] == "Muro Limpio mayor"):
        wallsClean.append(all[i - 1])
        boleanElements.append(True) 
    else:
        boleanElements.append(False) 

    
        
#return wallsClean 


# Assign your output to the OUT variable.
OUT = boleanElements
# ----------------------------------------
filterByBoolMask = List.FilterByBoolMask(list=python_script, mask=lista_muros_limpios_mayores)

# group: PARTICIÓN MUROS SIN HUECO
lista_de_muros = Python(IN[0]=filterByBoolMask.in, IN[1]=longitud_de_corte_m)  # CPython3
# ---------- lista_de_muros.python (61 lines) ----------
# Load the Python Standard and DesignScript Libraries
import sys
import clr
clr.AddReference('ProtoGeometry')
from Autodesk.DesignScript.Geometry import *

# Import RevitNodes
clr.AddReference("RevitNodes")
import Revit

# Import Revit elements
from Revit.Elements import *
import math



# The inputs to this node will be stored as a list in the IN variables.
dataEnteringNode = IN
muros_limpios_mayores = IN[0]
max_corte= IN[1]

# Place your code below this line

GetLocation_muros = []
longitudes_muros =[]
for muros in muros_limpios_mayores:
    longitud = muros.GetParameterValueByName("Length")
    longitudes_muros.append(longitud)
    GetLocation = muros.GetLocation()
    GetLocation_muros.append(GetLocation)


num_cortes_muros = []
lon_cortes_muros = []
parametros = []
list_remplace =[]

muro_limpio=0

for longitud_muro in longitudes_muros:
    numero_submuros = math.ceil(float(longitud_muro)/max_corte)
    longitud_submuro = float(longitud_muro)/numero_submuros
    num_cortes_muros.append(numero_submuros)
    lon_cortes_muros.append(longitud_submuro)
    porcentaje_submuro_in_muro = longitud_submuro/longitud_muro
    trayectorias = []
    parametros.append(trayectorias)
    posicion = 0.0
    while posicion<1:
        trayectorias.append(posicion)
        posicion += porcentaje_submuro_in_muro
    c = []
    contador_muros=0
    while contador_muros<numero_submuros:
        c.append(muros_limpios_mayores[muro_limpio])
        contador_muros += 1
    list_remplace.append(c)
    muro_limpio +=1

# Assign your output to the OUT variable.
OUT = list_remplace
# ----------------------------------------
byCoordinates = Vector.ByCoordinates()
copyByVector = Custom[Element.CopyByVector](element=lista_de_muros@@L1, vector=byCoordinates)  # package Clockwork for Dynamo 2.x; Copies an element or a list of elements by a given vector.
flatten = List.Flatten(list=copyByVector, lacing=Longest)
curvas_que_reemplazan_muro = Python(IN[0]=filterByBoolMask.in, IN[1]=longitud_de_corte_m)  # CPython3
# ---------- curvas_que_reemplazan_muro.python (63 lines) ----------
# Load the Python Standard and DesignScript Libraries
import sys
import clr
clr.AddReference('ProtoGeometry')
from Autodesk.DesignScript.Geometry import *

# Import RevitNodes
clr.AddReference("RevitNodes")
import Revit

# Import Revit elements
from Revit.Elements import *
import math



# The inputs to this node will be stored as a list in the IN variables.
dataEnteringNode = IN
muros_limpios_mayores = IN[0]
max_corte= IN[1]

# Place your code below this line

GetLocation_muros = []
longitudes_muros =[]
for muros in muros_limpios_mayores:
    longitud = muros.GetParameterValueByName("Length")
    longitudes_muros.append(longitud)
    GetLocation = muros.GetLocation()
    GetLocation_muros.append(GetLocation)


num_cortes_muros = []
lon_cortes_muros = []
parametros = []
list_remplace =[]

muro_limpio=0

for longitud_muro in longitudes_muros:
    numero_submuros = math.ceil(float(longitud_muro)/max_corte)
    longitud_submuro = float(longitud_muro)/numero_submuros
    num_cortes_muros.append(numero_submuros)
    lon_cortes_muros.append(longitud_submuro)
    porcentaje_submuro_in_muro = longitud_submuro/longitud_muro
    trayectorias = []
    parametros.append(trayectorias)
    posicion = 0.0
    while posicion<1:
        trayectorias.append(posicion)
        posicion += porcentaje_submuro_in_muro
    c = []
    contador_muros=0

curves = []
for i in range (0,len(GetLocation_muros)):
    curv = Curve.SplitByParameter(GetLocation_muros[i],parametros[i]) 
    curves.append(curv)



# Assign your output to the OUT variable.
OUT = curves
# ----------------------------------------
setLocation = Element.SetLocation(element=flatten, geometry=curvas_que_reemplazan_muro)
passThrough = Custom[PassThrough](waitFor=setLocation)  # package archi-lab.net; Ripped this off from Clockwork. Sorry Andy.; unwired: passThrough

# group: PARTICIÓN MUROS CON HUECO
python_script_3 = Python(IN[0]=filterByBoolMask.out, IN[1]=longitud_de_corte_m, IN[2]=borde_m)  # CPython3
# ---------- python_script_3.python (206 lines) ----------
# Load the Python Standard and DesignScript Libraries
import sys
import clr
clr.AddReference('ProtoGeometry')
from Autodesk.DesignScript.Geometry import *

# Import RevitNodes
clr.AddReference("RevitNodes")
clr.AddReference("archilab")

import Revit
import archilab

# Import Revit elements
from Revit.Elements import *
import math


DEBUG=[]
def debug_revit(*args): 
    DEBUG.append(f"uso debug: {len(args)}")
    for element in args:
        DEBUG.append(f"type:{type(element)}-->{element}")
    

# The inputs to this node will be stored as a list in the IN variables.
dataEnteringNode = IN
muros_huecos = IN[0]
CORTE= IN[1]
borde = IN[2]

# Place your code below this line
Lista_puntos=[]
Lista_distancias=[]
Lista_Ancho_hosted = []
Lista_Vector_direccion = []
Lista_num_cortes = []
Lista_curva_host = []
Lista_Lon_muro = []
a=0
GetLocation_muros = []

for muros in muros_huecos:
    GetLocation = muros.GetLocation()
    GetLocation_muros.append(GetLocation)
    start_location_muro = muros.GetLocation().StartPoint    
    end_location_muro = muros.GetLocation().EndPoint
    Longitud_muro = start_location_muro.DistanceTo(end_location_muro)
    Lista_Lon_muro.append(Longitud_muro)
    num_cortes = math.ceil(float(Longitud_muro/CORTE))-1
    Lista_num_cortes.append(num_cortes)
    hosted = muros.GetHostedElements()
    vector_dirección_x_muro = Vector.ByTwoPoints(start_location_muro,end_location_muro)
    Lista_Vector_direccion.append(vector_dirección_x_muro)
    Anchos_hosteds = []
    Distancias = []
    puntos = []
    sub_lista_curva_host = []
    puntos.append(start_location_muro)
    for i in hosted:
        Tipo_hosted = i.ElementType
        Ancho_hosted = Tipo_hosted.GetParameterValueByName("Width")
        Anchos_hosteds.append(Ancho_hosted)
        loclizacion_hosted = i.GetLocation()
        start_point_hosted = loclizacion_hosted.Translate(vector_dirección_x_muro, -(Ancho_hosted/2))
        end_point_hosted = loclizacion_hosted.Translate(vector_dirección_x_muro, (Ancho_hosted/2))        
        curva_host= Line.ByStartPointEndPoint(start_point_hosted,end_point_hosted)
        sub_lista_curva_host.append(curva_host)
        puntos.append(start_point_hosted)
        puntos.append(end_point_hosted)
        Distancia_start = start_location_muro.DistanceTo(start_point_hosted)
        Distancia_end = start_location_muro.DistanceTo(end_point_hosted)
        Distancias.append(Distancia_start)
        Distancias.append(Distancia_end)
    puntos.append(end_location_muro)
    Distancia_end_muro = start_location_muro.DistanceTo(end_location_muro)
    Distancias.append(Distancia_end_muro)
    Lista_Ancho_hosted.append(Anchos_hosteds)
    Lista_distancias.append(Distancias)
    Lista_puntos.append(puntos)
    Lista_curva_host.append(sub_lista_curva_host)

for i, sublista in enumerate(Lista_distancias):
    Lista_distancias[i] = sorted(sublista)

# Logica de division de muros    
Lista_puntos_cortes = []
Lista_Planos_ordenada = []
lista_j = []
crecimiento_k = []
Lista_porcentaje = []

for i in range (0, len(Lista_distancias)):
    k=0
    Lista_Planos =[]
    distancia_rest = 0
    lista_cortes = []
    Sublista_porcentaje =[]
    for indice, a in enumerate(Lista_distancias[i]): 
        if indice % 2 == 0:           
            if (indice == 0):
                distancia_rest = a
                if (distancia_rest>CORTE):            
                    if ((distancia_rest/CORTE)<=((CORTE+borde)/CORTE)):
                        longitud = distancia_rest-borde
                        porcentaje_submuro_in_muro = longitud/Lista_Lon_muro[i]
                        Punto_c1 = Lista_puntos[i][0].Translate(Lista_Vector_direccion[i],longitud)
                        Plano_per = Plane.ByOriginNormal(Punto_c1, Plane.ByOriginNormal(Punto_c1,Lista_Vector_direccion[i]).Normal)
                        lista_cortes.append(longitud)                    
                        Lista_Planos.append(Plano_per)
                        Sublista_porcentaje.append(porcentaje_submuro_in_muro)
                    else:
                        j=math.ceil(float(distancia_rest/CORTE))
                        lista_j.append(j)
                        for b in range (1,j+1):
                            longitud = ((distancia_rest-borde)/j)*b
                            porcentaje_submuro_in_muro = longitud/Lista_Lon_muro[i]
                            Punto_c1 = Lista_puntos[i][0].Translate(Lista_Vector_direccion[i],longitud)
                            Plano_per = Plane.ByOriginNormal(Punto_c1, Plane.ByOriginNormal(Punto_c1,Lista_Vector_direccion[i]).Normal)
                            Lista_Planos.append(Plano_per)
                            lista_cortes.append(longitud)
                            Sublista_porcentaje.append(porcentaje_submuro_in_muro)
                            debug_revit('punts:',Punto_c1)                        
                else:
                    if ((distancia_rest/borde)<2):
                        longitud = 0
                        porcentaje_submuro_in_muro = longitud/Lista_Lon_muro[i]
                        Punto_c1 = Lista_puntos[i][0].Translate(Lista_Vector_direccion[i],longitud)
                        lista_cortes.append(longitud)
                        Sublista_porcentaje.append(porcentaje_submuro_in_muro)
                        
                    else:
                        longitud = distancia_rest-borde
                        porcentaje_submuro_in_muro = longitud/Lista_Lon_muro[i]
                        Punto_c1 = Lista_puntos[i][0].Translate(Lista_Vector_direccion[i],longitud)
                        Plano_per = Plane.ByOriginNormal(Punto_c1, Plane.ByOriginNormal(Punto_c1,Lista_Vector_direccion[i]).Normal)
                        Lista_Planos.append(Plano_per)
                        Sublista_porcentaje.append(porcentaje_submuro_in_muro)
                        lista_cortes.append(longitud)            
            else:
                distancia_rest = a - Lista_distancias[i][indice-1]
                if (distancia_rest>CORTE):  
                    londitud2 = Lista_distancias[i][indice-1] + borde
                    porcentaje_submuro_in_muro = londitud2/Lista_Lon_muro[i]
                    Punto_c2 = Lista_puntos[i][0].Translate(Lista_Vector_direccion[i],londitud2)
                    Plano_per2 = Plane.ByOriginNormal(Punto_c2, Plane.ByOriginNormal(Punto_c2,Lista_Vector_direccion[i]).Normal)
                    Lista_Planos.append(Plano_per2)
                    lista_cortes.append(londitud2)
                    Sublista_porcentaje.append(porcentaje_submuro_in_muro)
                    
                    if (((a-londitud2)/CORTE) > 1):
                        j=math.ceil(float(distancia_rest/CORTE))
                        lista_j.append(j)
                        for b in range (1,j+1):
                            longitud3 = (((a-londitud2)/j)*b)+londitud2
                            porcentaje_submuro_in_muro = longitud3/Lista_Lon_muro[i]
                            Punto_c3 = Lista_puntos[i][0].Translate(Lista_Vector_direccion[i],longitud3)
                            Plano_per = Plane.ByOriginNormal(Punto_c3, Plane.ByOriginNormal(Punto_c3,Lista_Vector_direccion[i]).Normal)
                            Lista_Planos.append(Plano_per)
                            lista_cortes.append(longitud3)
                            Sublista_porcentaje.append(porcentaje_submuro_in_muro)
                            debug_revit('punts:',Punto_c3)                     
                    else:
                        longitud2 = 0
                        porcentaje_submuro_in_muro = longitud2/Lista_Lon_muro[i]
                        Punto_c3 = Lista_puntos[i][0].Translate(Lista_Vector_direccion[i],longitud2)
                        lista_cortes.append(longitud2)
                        Sublista_porcentaje.append(porcentaje_submuro_in_muro)
                                                
                else:
                    if ((a-(Lista_distancias[i][indice-2]-borde))<=CORTE):
                        longitud2 = 0
                        porcentaje_submuro_in_muro = longitud2/Lista_Lon_muro[i]
                        Punto_c3 = Lista_puntos[i][0].Translate(Lista_Vector_direccion[i],longitud2)
                        lista_cortes.append(longitud2)
                        Sublista_porcentaje.append(porcentaje_submuro_in_muro)
                    else:
                        longitud2 = Lista_distancias[i][indice-1]+borde
                        porcentaje_submuro_in_muro = longitud2/Lista_Lon_muro[i]
                        Punto_c3 = Lista_puntos[i][0].Translate(Lista_Vector_direccion[i],longitud2)
                        Plano_per = Plane.ByOriginNormal(Punto_c3, Plane.ByOriginNormal(Punto_c3,Lista_Vector_direccion[i]).Normal)
                        Lista_Planos.append(Plano_per)
                        lista_cortes.append(longitud2)                                             
                        Sublista_porcentaje.append(porcentaje_submuro_in_muro)                                           
            
    Lista_Planos_ordenada.append(Lista_Planos)
    Lista_puntos_cortes.append(lista_cortes)
    Lista_porcentaje.append(Sublista_porcentaje)
    
curves = []
muro_limpio = 0
list_remplace = []
for i in range (0,len(GetLocation_muros)):
    curv = Curve.SplitByParameter(GetLocation_muros[i],Lista_porcentaje[i]) 
    curves.append(curv)
    c = []
    contador_muros=0
    while contador_muros<len(Lista_porcentaje[i]):
        c.append(muros_huecos[muro_limpio])
        contador_muros += 1
    list_remplace.append(c)
    muro_limpio +=1    

debug_revit(longitud,Punto_c1)
# Assign your output to the OUT variable.
OUT = list_remplace
# ----------------------------------------
byCoordinates_2 = Vector.ByCoordinates()
copyByVector_2 = Custom[Element.CopyByVector](element=python_script_3@@L1, vector=byCoordinates_2)
flatten_2 = List.Flatten(list=copyByVector_2, lacing=Longest)
python_script_4 = Python(IN[0]=filterByBoolMask.out, IN[1]=longitud_de_corte_m, IN[2]=borde_m)  # CPython3
# ---------- python_script_4.python (207 lines) ----------
# Load the Python Standard and DesignScript Libraries
import sys
import clr
clr.AddReference('ProtoGeometry')
from Autodesk.DesignScript.Geometry import *

# Import RevitNodes
clr.AddReference("RevitNodes")
clr.AddReference("archilab")

import Revit
import archilab

# Import Revit elements
from Revit.Elements import *
import math


DEBUG=[]
def debug_revit(*args): 
    DEBUG.append(f"uso debug: {len(args)}")
    for element in args:
        DEBUG.append(f"type:{type(element)}-->{element}")
    

# The inputs to this node will be stored as a list in the IN variables.
dataEnteringNode = IN
muros_huecos = IN[0]
CORTE= IN[1]
borde = IN[2]

# Place your code below this line
Lista_puntos=[]
Lista_distancias=[]
Lista_Ancho_hosted = []
Lista_Vector_direccion = []
Lista_num_cortes = []
Lista_curva_host = []
Lista_Lon_muro = []
a=0
GetLocation_muros = []

for muros in muros_huecos:
    GetLocation = muros.GetLocation()
    GetLocation_muros.append(GetLocation)
    start_location_muro = muros.GetLocation().StartPoint    
    end_location_muro = muros.GetLocation().EndPoint
    Longitud_muro = start_location_muro.DistanceTo(end_location_muro)
    Lista_Lon_muro.append(Longitud_muro)
    num_cortes = math.ceil(float(Longitud_muro/CORTE))-1
    Lista_num_cortes.append(num_cortes)
    hosted = muros.GetHostedElements()
    vector_dirección_x_muro = Vector.ByTwoPoints(start_location_muro,end_location_muro)
    Lista_Vector_direccion.append(vector_dirección_x_muro)
    Anchos_hosteds = []
    Distancias = []
    puntos = []
    sub_lista_curva_host = []
    puntos.append(start_location_muro)
    for i in hosted:
        Tipo_hosted = i.ElementType
        Ancho_hosted = Tipo_hosted.GetParameterValueByName("Width")
        Anchos_hosteds.append(Ancho_hosted)
        loclizacion_hosted = i.GetLocation()
        start_point_hosted = loclizacion_hosted.Translate(vector_dirección_x_muro, -(Ancho_hosted/2))
        end_point_hosted = loclizacion_hosted.Translate(vector_dirección_x_muro, (Ancho_hosted/2))        
        curva_host= Line.ByStartPointEndPoint(start_point_hosted,end_point_hosted)
        sub_lista_curva_host.append(curva_host)
        puntos.append(start_point_hosted)
        puntos.append(end_point_hosted)
        Distancia_start = start_location_muro.DistanceTo(start_point_hosted)
        Distancia_end = start_location_muro.DistanceTo(end_point_hosted)
        Distancias.append(Distancia_start)
        Distancias.append(Distancia_end)
    puntos.append(end_location_muro)
    Distancia_end_muro = start_location_muro.DistanceTo(end_location_muro)
    Distancias.append(Distancia_end_muro)
    Lista_Ancho_hosted.append(Anchos_hosteds)
    Lista_distancias.append(Distancias)
    Lista_puntos.append(puntos)
    Lista_curva_host.append(sub_lista_curva_host)

for i, sublista in enumerate(Lista_distancias):
    Lista_distancias[i] = sorted(sublista)

# Logica de division de muros    
Lista_puntos_cortes = []
Lista_Planos_ordenada = []
lista_j = []
crecimiento_k = []
Lista_porcentaje = []

for i in range (0, len(Lista_distancias)):
    k=0
    Lista_Planos =[]
    distancia_rest = 0
    lista_cortes = []
    Sublista_porcentaje =[]
    for indice, a in enumerate(Lista_distancias[i]): 
        if indice % 2 == 0:           
            if (indice == 0):
                distancia_rest = a
                if (distancia_rest>CORTE):            
                    if ((distancia_rest/CORTE)<=((CORTE+borde)/CORTE)):
                        longitud = distancia_rest-borde
                        porcentaje_submuro_in_muro = longitud/Lista_Lon_muro[i]
                        Punto_c1 = Lista_puntos[i][0].Translate(Lista_Vector_direccion[i],longitud)
                        Plano_per = Plane.ByOriginNormal(Punto_c1, Plane.ByOriginNormal(Punto_c1,Lista_Vector_direccion[i]).Normal)
                        lista_cortes.append(longitud)                    
                        Lista_Planos.append(Plano_per)
                        Sublista_porcentaje.append(porcentaje_submuro_in_muro)
                    else:
                        j=math.ceil(float(distancia_rest/CORTE))
                        lista_j.append(j)
                        for b in range (1,j+1):
                            longitud = ((distancia_rest-borde)/j)*b
                            porcentaje_submuro_in_muro = longitud/Lista_Lon_muro[i]
                            Punto_c1 = Lista_puntos[i][0].Translate(Lista_Vector_direccion[i],longitud)
                            Plano_per = Plane.ByOriginNormal(Punto_c1, Plane.ByOriginNormal(Punto_c1,Lista_Vector_direccion[i]).Normal)
                            Lista_Planos.append(Plano_per)
                            lista_cortes.append(longitud)
                            Sublista_porcentaje.append(porcentaje_submuro_in_muro)
                            debug_revit('punts:',Punto_c1)                        
                else:
                    if ((distancia_rest/borde)<2):
                        longitud = 0
                        porcentaje_submuro_in_muro = longitud/Lista_Lon_muro[i]
                        Punto_c1 = Lista_puntos[i][0].Translate(Lista_Vector_direccion[i],longitud)
                        lista_cortes.append(longitud)
                        Sublista_porcentaje.append(porcentaje_submuro_in_muro)
                        
                    else:
                        longitud = distancia_rest-borde
                        porcentaje_submuro_in_muro = longitud/Lista_Lon_muro[i]
                        Punto_c1 = Lista_puntos[i][0].Translate(Lista_Vector_direccion[i],longitud)
                        Plano_per = Plane.ByOriginNormal(Punto_c1, Plane.ByOriginNormal(Punto_c1,Lista_Vector_direccion[i]).Normal)
                        Lista_Planos.append(Plano_per)
                        Sublista_porcentaje.append(porcentaje_submuro_in_muro)
                        lista_cortes.append(longitud)            
            else:
                distancia_rest = a - Lista_distancias[i][indice-1]
                if (distancia_rest>CORTE):  
                    londitud2 = Lista_distancias[i][indice-1] + borde
                    porcentaje_submuro_in_muro = londitud2/Lista_Lon_muro[i]
                    Punto_c2 = Lista_puntos[i][0].Translate(Lista_Vector_direccion[i],londitud2)
                    Plano_per2 = Plane.ByOriginNormal(Punto_c2, Plane.ByOriginNormal(Punto_c2,Lista_Vector_direccion[i]).Normal)
                    Lista_Planos.append(Plano_per2)
                    lista_cortes.append(londitud2)
                    Sublista_porcentaje.append(porcentaje_submuro_in_muro)
                    
                    if (((a-londitud2)/CORTE) > 1):
                        j=math.ceil(float(distancia_rest/CORTE))
                        lista_j.append(j)
                        for b in range (1,j+1):
                            longitud3 = (((a-londitud2)/j)*b)+londitud2
                            porcentaje_submuro_in_muro = longitud3/Lista_Lon_muro[i]
                            Punto_c3 = Lista_puntos[i][0].Translate(Lista_Vector_direccion[i],longitud3)
                            Plano_per = Plane.ByOriginNormal(Punto_c3, Plane.ByOriginNormal(Punto_c3,Lista_Vector_direccion[i]).Normal)
                            Lista_Planos.append(Plano_per)
                            lista_cortes.append(longitud3)
                            Sublista_porcentaje.append(porcentaje_submuro_in_muro)
                            debug_revit('punts:',Punto_c3)                     
                    else:
                        longitud2 = 0
                        porcentaje_submuro_in_muro = longitud2/Lista_Lon_muro[i]
                        Punto_c3 = Lista_puntos[i][0].Translate(Lista_Vector_direccion[i],longitud2)
                        lista_cortes.append(longitud2)
                        Sublista_porcentaje.append(porcentaje_submuro_in_muro)
                                                
                else:
                    if ((a-(Lista_distancias[i][indice-2]-borde))<=CORTE):
                        longitud2 = 0
                        porcentaje_submuro_in_muro = longitud2/Lista_Lon_muro[i]
                        Punto_c3 = Lista_puntos[i][0].Translate(Lista_Vector_direccion[i],longitud2)
                        lista_cortes.append(longitud2)
                        Sublista_porcentaje.append(porcentaje_submuro_in_muro)
                    else:
                        longitud2 = Lista_distancias[i][indice-1]+borde
                        porcentaje_submuro_in_muro = longitud2/Lista_Lon_muro[i]
                        Punto_c3 = Lista_puntos[i][0].Translate(Lista_Vector_direccion[i],longitud2)
                        Plano_per = Plane.ByOriginNormal(Punto_c3, Plane.ByOriginNormal(Punto_c3,Lista_Vector_direccion[i]).Normal)
                        Lista_Planos.append(Plano_per)
                        lista_cortes.append(longitud2)                                             
                        Sublista_porcentaje.append(porcentaje_submuro_in_muro)
            
    Lista_Planos_ordenada.append(Lista_Planos)
    Lista_puntos_cortes.append(lista_cortes)
    Lista_porcentaje.append(Sublista_porcentaje)
    
curves = []
muro_limpio = 0
list_remplace = []
for i in range (0,len(GetLocation_muros)):
    curv = Curve.SplitByParameter(GetLocation_muros[i],Lista_porcentaje[i]) 
    curves.append(curv)
    c = []
    contador_muros=0
    while contador_muros<len(Lista_porcentaje[i]):
        c.append(muros_huecos[muro_limpio])
        contador_muros += 1
    list_remplace.append(c)
    muro_limpio +=1    

    
debug_revit(longitud,Punto_c1)
# Assign your output to the OUT variable.
OUT = curves
# ----------------------------------------
setLocation_2 = Element.SetLocation(element=flatten_2, geometry=python_script_4)
passThrough_2 = Custom[PassThrough](waitFor=setLocation_2)  # unwired: passThrough
