# Dynamo graph 2_ASSEMBLY_MURO_3D.dyn (Dynamo 2.13.1.3887)

# group: Obtener lineas de muros
categories = Categories("OST_Walls")
all_elements_of_category = ElementsOfCategory(Category=categories)
getLocation = Element.GetLocation(element=all_elements_of_category)
ejeMuroOriginal = Curve.NormalAtParameter(curve=getLocation)  # "Curva.EjeMuroOriginal"
ancho_muro = DoubleInput(0.2)  # graph input
diametro_boquilla = DoubleInput(0.05)  # graph input
code_block = CodeBlock(AnchoMuro=ancho_muro, DiametroBoquilla=diametro_boquilla) { (AnchoMuro/2)-(DiametroBoquilla/2); }
code_block_2 = CodeBlock { -1; }
mul = code_block * code_block_2
ejeMuroExterior3D = Geometry.Translate(geometry=getLocation, direction=ejeMuroOriginal, distance=mul)  # "Curva.EjeMuroExterior3D"
ejeMuroInterior3D = Geometry.Translate(geometry=getLocation, direction=ejeMuroOriginal, distance=code_block)  # "Curva.EjeMuroInterior3D"
startPoint = Curve.StartPoint(curve=ejeMuroInterior3D)
endPoint = Curve.EndPoint(curve=ejeMuroInterior3D)
startPoint_2 = Curve.StartPoint(curve=ejeMuroExterior3D)
endPoint_2 = Curve.EndPoint(curve=ejeMuroExterior3D)

# group: Desplazar puntos extremos
byTwoPoints = Vector.ByTwoPoints(start=startPoint, end=endPoint)
code_block_3 = CodeBlock(DiametroBoquilla=diametro_boquilla) { DiametroBoquilla/2; }
translate = Geometry.Translate(geometry=startPoint, direction=byTwoPoints, distance=code_block_3)
byTwoPoints_2 = Vector.ByTwoPoints(start=startPoint_2, end=endPoint_2)
translate_2 = Geometry.Translate(geometry=startPoint_2, direction=byTwoPoints_2, distance=code_block_3)
byTwoPoints_3 = Vector.ByTwoPoints(start=endPoint, end=startPoint)
translate_3 = Geometry.Translate(geometry=endPoint, direction=byTwoPoints_3, distance=code_block_3)
byTwoPoints_4 = Vector.ByTwoPoints(start=endPoint_2, end=startPoint_2)
translate_4 = Geometry.Translate(geometry=endPoint_2, direction=byTwoPoints_4, distance=code_block_3)

# group: Crear Muros
altura_de_muro = DoubleInput(2.8)  # graph input
levels = Levels("Level 1")  # graph input
wall_types = WallTypes("3DPC- 50mm")  # graph input
byCurveAndHeight = Wall.ByCurveAndHeight(curve=ejeMuroExterior3D, height=altura_de_muro, level=levels, wallType=wall_types)
byCurveAndHeight_2 = Wall.ByCurveAndHeight(curve=ejeMuroInterior3D, height=altura_de_muro, level=levels, wallType=wall_types)
byStartPointEndPoint = Line.ByStartPointEndPoint(startPoint=translate, endPoint=translate_2)
byCurveAndHeight_3 = Wall.ByCurveAndHeight(curve=byStartPointEndPoint, height=altura_de_muro, level=levels, wallType=wall_types)
byStartPointEndPoint_2 = Line.ByStartPointEndPoint(startPoint=translate_3, endPoint=translate_4)
byCurveAndHeight_4 = Wall.ByCurveAndHeight(curve=byStartPointEndPoint_2, height=altura_de_muro, level=levels, wallType=wall_types)

# group: Insertar Host en muros 3D
family_types = FamilyTypes("Familia de Apertura-Opening:Tipo 1")
localización_hosted = Python(IN[0]=all_elements_of_category)  # CPython3
# ---------- localización_hosted.python (39 lines) ----------
# Load the Python Standard and DesignScript Libraries
import sys
import clr
clr.AddReference('ProtoGeometry')
from Autodesk.DesignScript.Geometry import *

# Import RevitNodes
clr.AddReference("RevitNodes")
clr.AddReference("archilab")

import Revit
import archilab

# Import Revit elements
from Revit.Elements import *
import math


# The inputs to this node will be stored as a list in the IN variables.
dataEnteringNode = IN
muros = IN[0]

# Place your code below this line
Lista_puntos=[]
Lista_hosteds=[]
GetLocation_muros = []

for muro in muros:
    hosted = muro.GetHostedElements()
    puntos = []
    for i in hosted:
        Tipo_hosted = i.ElementType
        Lista_hosteds.append(Tipo_hosted)
        loclizacion_hosted = i.GetLocation()    
        puntos.append(loclizacion_hosted)
    Lista_puntos.append(puntos)

# Assign your output to the OUT variable.
OUT = Lista_puntos
# ----------------------------------------
vector_director_muro = Python(IN[0]=all_elements_of_category)  # CPython3
# ---------- vector_director_muro.python (58 lines) ----------
# Load the Python Standard and DesignScript Libraries
import sys
import clr
clr.AddReference('ProtoGeometry')
from Autodesk.DesignScript.Geometry import *

# Import RevitNodes
clr.AddReference("RevitNodes")
clr.AddReference("archilab")

import Revit
import archilab

# Import Revit elements
from Revit.Elements import *
import math


# The inputs to this node will be stored as a list in the IN variables.
dataEnteringNode = IN
muros = IN[0]

# Place your code below this line
Lista_puntos=[]
Lista_hosteds=[]
Lista_Ancho_hosted = []
Lista_Vector_direccion = []
Lista_Lon_muro = []
a=0
GetLocation_muros = []

for muro in muros:
    GetLocation = muro.GetLocation()
    GetLocation_muros.append(GetLocation)
    start_location_muro = muro.GetLocation().StartPoint    
    end_location_muro = muro.GetLocation().EndPoint
    Longitud_muro = start_location_muro.DistanceTo(end_location_muro)
    Lista_Lon_muro.append(Longitud_muro)
    hosted = muro.GetHostedElements()
    vector_dirección_x_muro = Vector.ByTwoPoints(start_location_muro,end_location_muro)
    Lista_Vector_direccion.append(vector_dirección_x_muro)
    Anchos_hosteds = []
    puntos = []
    for i in hosted:
        Tipo_hosted = i.ElementType
        Lista_hosteds.append(Tipo_hosted)
        Ancho_hosted = Tipo_hosted.GetParameterValueByName("Width")
        Anchos_hosteds.append(Ancho_hosted)
        loclizacion_hosted = i.GetLocation()
        start_point_hosted = loclizacion_hosted.Translate(vector_dirección_x_muro, -(Ancho_hosted/2))
        end_point_hosted = loclizacion_hosted.Translate(vector_dirección_x_muro, (Ancho_hosted/2))        
        puntos.append(start_point_hosted)
        puntos.append(end_point_hosted)
    Lista_Ancho_hosted.append(Anchos_hosteds)
    Lista_puntos.append(puntos)

# Assign your output to the OUT variable.
OUT = Lista_Vector_direccion
# ----------------------------------------
ZAxis = Vector.ZAxis()
code_block_4 = CodeBlock { 90; }
rotate = Vector.Rotate(vector=vector_director_muro, axis=ZAxis, degrees=code_block_4)
code_block_5 = CodeBlock(AnchoMuro=ancho_muro, DiametroBoquilla=diametro_boquilla) { (AnchoMuro/2)-(DiametroBoquilla/2); }
punto_insertar_host_muro_externo = Geometry.Translate(geometry=localización_hosted, direction=rotate, distance=code_block_5)
byHostAndPoint = FamilyInstance.ByHostAndPoint(familyType=family_types, host=byCurveAndHeight, point=punto_insertar_host_muro_externo)
code_block_6 = CodeBlock { "01_Height_Opening"; "02_Width_Opening"; "03_Area_Opening"; "04_Volume_Opening"; }
getParameterValueByName = Element.GetParameterValueByName(element=byHostAndPoint, parameterName=code_block_6.out2)
code_block_7 = CodeBlock(area=getParameterValueByName) { area*0.05; }
volumen = Element.SetParameterByName(element=byHostAndPoint, parameterName=code_block_6.out3, value=code_block_7)
height_hosted = Python(IN[0]=all_elements_of_category)  # CPython3
# ---------- height_hosted.python (39 lines) ----------
# Load the Python Standard and DesignScript Libraries
import sys
import clr
clr.AddReference('ProtoGeometry')
from Autodesk.DesignScript.Geometry import *

# Import RevitNodes
clr.AddReference("RevitNodes")
clr.AddReference("archilab")

import Revit
import archilab

# Import Revit elements
from Revit.Elements import *
import math


# The inputs to this node will be stored as a list in the IN variables.
dataEnteringNode = IN
muros = IN[0]

# Place your code below this line
Lista_puntos=[]
Lista_hosteds=[]
GetLocation_muros = []
Lista_Alto_hosted = []

for muro in muros:
    hosted = muro.GetHostedElements()
    Alto = []
    for i in hosted:
        Tipo_hosted = i.ElementType
        Alto_hosted = Tipo_hosted.GetParameterValueByName("Height")     
        Alto.append(Alto_hosted)
    Lista_Alto_hosted.append(Alto)
    
# Assign your output to the OUT variable.
OUT = Lista_Alto_hosted
# ----------------------------------------
height = Element.SetParameterByName(element=byHostAndPoint, parameterName=code_block_6.out0, value=height_hosted)
widht_hosted = Python(IN[0]=all_elements_of_category)  # CPython3
# ---------- widht_hosted.python (39 lines) ----------
# Load the Python Standard and DesignScript Libraries
import sys
import clr
clr.AddReference('ProtoGeometry')
from Autodesk.DesignScript.Geometry import *

# Import RevitNodes
clr.AddReference("RevitNodes")
clr.AddReference("archilab")

import Revit
import archilab

# Import Revit elements
from Revit.Elements import *
import math


# The inputs to this node will be stored as a list in the IN variables.
dataEnteringNode = IN
muros = IN[0]

# Place your code below this line
Lista_puntos=[]
Lista_hosteds=[]
GetLocation_muros = []
Lista_Ancho_hosted = []

for muro in muros:
    hosted = muro.GetHostedElements()
    anchos = []
    for i in hosted:
        Tipo_hosted = i.ElementType
        Ancho_hosted = Tipo_hosted.GetParameterValueByName("Width")     
        anchos.append(Ancho_hosted)
    Lista_Ancho_hosted.append(anchos)
    
# Assign your output to the OUT variable.
OUT = Lista_Ancho_hosted
# ----------------------------------------
widht = Element.SetParameterByName(element=byHostAndPoint, parameterName=code_block_6.out1, value=widht_hosted)
code_block_8 = CodeBlock { -1; }
mul_2 = code_block_5 * code_block_8
punto_insertar_host_muro_interno = Geometry.Translate(geometry=localización_hosted, direction=rotate, distance=mul_2)
byHostAndPoint_2 = FamilyInstance.ByHostAndPoint(familyType=family_types, host=byCurveAndHeight_2, point=punto_insertar_host_muro_interno)
height_2 = Element.SetParameterByName(element=byHostAndPoint_2, parameterName=code_block_6.out0, value=height_hosted)
widht_2 = Element.SetParameterByName(element=byHostAndPoint_2, parameterName=code_block_6.out1, value=widht_hosted)
getParameterValueByName_2 = Element.GetParameterValueByName(element=byHostAndPoint_2, parameterName=code_block_6.out2)
code_block_9 = CodeBlock(area=getParameterValueByName_2) { area*0.05; }
volumen_2 = Element.SetParameterByName(element=byHostAndPoint_2, parameterName=code_block_6.out3, value=code_block_9)

# group: Crear Ensamblaje
listaOrganizada = Python(IN[0]=byCurveAndHeight_2, IN[1]=byCurveAndHeight, IN[2]=byCurveAndHeight_3, IN[3]=byCurveAndHeight_4)  # CPython3
# ---------- listaOrganizada.python (23 lines) ----------
# Load the Python Standard and DesignScript Libraries
import sys
import clr
clr.AddReference('ProtoGeometry')
from Autodesk.DesignScript.Geometry import *

# The inputs to this node will be stored as a list in the IN variables.
dataEnteringNode = IN
muro_interno = IN[0]
muro_externo = IN[1]
muro_bordeA = IN[2]
muro_bordeB = IN[3]
# Place your code below this line

def lista_de_listas(lista1, lista2, lista3, lista4):
    # Combina las listas elemento por elemento usando zip
    combinadas = zip(lista1, lista2, lista3, lista4)
    # Convierte los resultados en una lista de listas
    lista_resultante = [list(elementos) for elementos in combinadas]
    return lista_resultante
    
# Assign your output to the OUT variable.
OUT = lista_de_listas(muro_interno,muro_externo,muro_bordeA,muro_bordeB)
# ----------------------------------------
boolean = BoolSelector(true)
crearAssemblyMuros = Python(IN[0]=listaOrganizada, IN[1]=boolean)  # CPython3
# ---------- crearAssemblyMuros.python (49 lines) ----------
import sys
import clr
import System
from System.Collections.Generic import List
# dynamo transaction
clr.AddReference('RevitServices')
import RevitServices
from RevitServices.Persistence import DocumentManager
from RevitServices.Transactions import TransactionManager

# revit dlls
clr.AddReference('RevitAPI')
import Autodesk
from Autodesk.Revit.DB import *
import Autodesk.Revit.DB as DB

clr.AddReference('RevitAPIUI')
from Autodesk.Revit.UI.Selection import *
doc = DocumentManager.Instance.CurrentDBDocument
uiapp = DocumentManager.Instance.CurrentUIApplication

muros=IN[0]
a=0
for muro in muros:
    if IN[1]:  # boolean node
    	# unwrap dynamo elements to revit elements
        el_L = UnwrapElement(   muro   )
        TransactionManager.Instance.ForceCloseTransaction()
        # convert el_id python List to .NET list
        el_id_NET_L = List[ElementId]([el.Id  for el in el_L])
        bic = el_L[0].Category.Id.IntegerValue
        bic_Id = ElementId(bic)
        # check if category can be used
        if (not AssemblyInstance.IsValidNamingCategory(doc, bic_Id, el_id_NET_L)):
        	raise ValueError('"{}" category can not be used for the input els.'.format(DB.LabelUtils.GetLabelFor(bic)) )
        tg = DB.TransactionGroup(doc, "create assembly")
        tg.Start()
        #
        with DB.Transaction(doc) as t1:
        	t1.Start("create assembly")
        	assembly = AssemblyInstance.Create(doc, el_id_NET_L, bic_Id)
        	t1.Commit()
        #
        with DB.Transaction(doc) as t2:
        	t2.Start(f"change Name {a}")
        	assembly.AssemblyTypeName = f"Assembly {a}"
        	t2.Commit()
        tg.Assimilate()
    a=a+1
# ----------------------------------------
code_block_10 = CodeBlock { 15; }
pause = Thread.Pause(object=crearAssemblyMuros, msTimeout=code_block_10)
