# Dynamo graph 3_ASSEMBLY_VISTA_POR_ELEMENTO.dyn (Dynamo 2.13.1.3887)
# packages: archi-lab.net 2023.213.1722, Clockwork for Dynamo 2.x 2.4.0, SteamNodes 1.2.4

views = Views("{3D}")
string = StringInput("Muro")  # graph input
categories = Categories("OST_Assemblies")  # frozen
all_elements_of_category = ElementsOfCategory(Category=categories)
code_block = CodeBlock { "length"; }
getParameterValueByName = Element.GetParameterValueByName(element=all_elements_of_category, parameterName=code_block)
count = List.Count(list=getParameterValueByName)
code_block_2 = CodeBlock(x=count) { 0..x..1; }
code_block_3 = CodeBlock(a=string, i=code_block_2) { a+" "+i; }
code_block_4 = CodeBlock { "Duplicate"; }
duplicate = archilab.Revit.Views.Views.Duplicate(view=views, name=code_block_3, options=code_block_4)
permanentlyIsolateElement = Custom[View.PermanentlyIsolateElement](view=duplicate, element=all_elements_of_category)  # package Clockwork for Dynamo 2.x; Permanently isolates elements in the given view
watch = Watch(permanentlyIsolateElement.view)
categories_2 = Categories("OST_Assemblies")
all_elements_of_category_2 = ElementsOfCategory(Category=categories_2)
family_types = FamilyTypes("A1 metric:A1 metric")
boolean = BoolSelector(true)
boolean_2 = BoolSelector(false)
assembly_Views = Custom[Tool.Assembly_Views](all_elements_of_category_2, TitleBlockType=family_types, CreateSheet=boolean, ElevationRight=boolean_2, ElevationFront=boolean_2, ElevationBack=boolean_2, PartList=boolean_2, ElevationLeft=boolean_2, ElevationTop=boolean_2, ElevationBottom=boolean_2, Ortho3D=boolean, PlanView=boolean_2, DetailSectionA=boolean_2, DetailSectionB=boolean_2)  # package SteamNodes; Create Sheet and Views for Assembly instances
