# Dynamo graph 4_ASSEMBLY_EXPORTAR_STL.dyn (Dynamo 2.13.1.3887)
# packages: archi-lab.net 2023.213.1722

categories = Categories("OST_Views")
all_elements_of_category = ElementsOfCategory(Category=categories)
name = Element.Name(element=all_elements_of_category)
string = StringInput("false")  # graph input
replaceNull = archilab.Lists.Lists.ReplaceNull(list=name, replacement=string)
string_2 = StringInput("Ortho")  # graph input
contains = String.Contains(string=replaceNull, searchFor=string_2)
filterByBoolMask = List.FilterByBoolMask(list=all_elements_of_category, mask=contains)
categories_2 = Categories("OST_Assemblies")
all_elements_of_category_2 = ElementsOfCategory(Category=categories_2)
name_2 = Element.Name(element=all_elements_of_category_2)
uniqueItems = List.UniqueItems(list=name_2)
code_block = CodeBlock(num=uniqueItems) { "Ortho "+num; }
setName = archilab.Revit.Views.Views.SetName(view=filterByBoolMask.in, name=code_block)
name_3 = Element.Name(element=setName)
code_block_2 = CodeBlock { 20; }
pause = Thread.Pause(object=name_3, msTimeout=code_block_2)
directory_path = Directory("C:\Users\laura\OneDrive\Documentos\stl")  # graph input
python_script = Python(IN[0]=pause, IN[1]=directory_path)  # CPython3
# ---------- python_script.python (35 lines) ----------
# Load the Python Standard and DesignScript Libraries
import sys
import clr
import RevitServices
clr.AddReference('RevitServices')
from RevitServices.Persistence import DocumentManager
clr.AddReference("RevitAPI")
from Autodesk.Revit.DB import Document, STLExportOptions, FilteredElementCollector, View
from Autodesk.Revit.DB import BuiltInCategory
import os
# documents and standard variables
doc = DocumentManager.Instance.CurrentDBDocument

# Obtén la vista que deseas exportar (reemplaza "Nombre de la Vista" con el nombre de tu vista)
lista_vistas = IN[0] 

for vista_deseada in lista_vistas:
    vista = FilteredElementCollector(doc).OfCategory(BuiltInCategory.OST_Views).WhereElementIsNotElementType().ToElements()
    nombre= str(vista_deseada)+".stl"
    # Filtra las vistas por nombre
    vista_deseada = next((v for v in vista if v.Name == vista_deseada), None)

    # Verifica si la vista deseada existe
    if vista_deseada is not None:
        stlOpts = STLExportOptions()
        stlOpts.ViewId = vista_deseada.Id
        # Define la ruta y nombre del archivo STL de destino
        path = os.path.join(IN[1])
    
        # Exporta la vista a STL
        doc.Export(path, nombre, stlOpts)
    
        OUT =  [stlOpts.IsValidObject, path, doc]
    else:
        OUT =   "La vista especificada no se encontró en el proyecto."
# ----------------------------------------
